# Grasshopper definition find_lot.gh (Grasshopper 1.0.8)

py3 = Python3Script(script=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)  # -> out, all_lot_crvs, road_crvs, landlocked_crvs, normal_crvs; unedited script template
geo = Geometry(py3.normal_crvs)
boundary = BoundarySurfaces(Edges=py3.road_crvs)
panel = Panel(py3.out)
